# Grasshopper definition BricksRotated.gh (Grasshopper 1.0.7)
# plug-ins: dotbimGH, Brontosaurus

calendar = Calendar()
box = CenterBox(Base=PlaneXY(0, 0, 0), X=1, Y=2, Z=5)
mbox = MeshBox(Base=box, XCount=1, YCount=1, ZCount=1)
tri = Triangulate(Mesh=mbox)  # -> Mesh, Count
crv = Curve(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)
divide = DivideCurve(Curve=crv, Count=Slider(71, range=0..100), Kinks=False)  # -> Points, Tangents, Parameters
pdecon = Deconstruct(Point=divide.Points)  # -> XComponent, YComponent, ZComponent
sort = SortList(Keys=pdecon.ZComponent)  # -> Keys, ValuesA
item = ListItem(List=sort.Keys, Index=0, Wrap=True)  # -> Item1, Item
gradient = Gradient(
    LowerLimit=0,
    UpperLimit=item.Item1,
    Parameter=pdecon.ZComponent,
    stops=[0: RGB(80, 55, 25), 0.5: RGB(159, 65, 29), 1: RGB(174, 166, 129)])
pl = PlaneNormal(Origin=divide.Points, ZAxis=divide.Tangents)
lng = ListLength(List=pl)
create_info = CreateInfo(Keys="Z Level", Values=graft(pdecon.ZComponent))
dup = DuplicateData(Data="Brick", Number=lng, Order=True)
txt = Text(["91d1ebcf-9daa-4eca-af97-e8ca9e69245f", "08fbe145-ecbd-479f-a178-0750b996f08b", "3cb06912-72da-41a9-931c-3fae9d8e7dc4", "949ea549-c670-4a6c-9b72-467914069d2e", "039068c0-bdca-4a29-bc86-a8861120a288", "53583884-5fcc-4028-87f5-2c53446f3077", "ed9da469-7ec9-4a94-ae57-97d997834a3c", "63e0d631-0753-42ef-9e87-bb7e570e22da", "1e596675-436f-4725-8f3e-4f04c4a3ca73", "03bdd50e-40db-4144-8663-d974e7e0b93a"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])
create_elements_set = CreateElementsSet(Mesh=tri.Mesh, InsertPlanes=pl, Guids=txt, Types=dup, Colors=gradient, Info=flatten(create_info))  # -> ElementsSet, Preview
# Change the file path
panel = Panel("John Doe")
create_info_2 = CreateInfo(Keys="Author", Values=panel)
# Connect here to read the file
path = FilePath("C:\Users\pc\RiderProjects\dotbimGH\TestsInsideGH\BricksRotated.bim")
create_file = CreateFile(ElementsSetsOrElements=create_elements_set.ElementsSet, Info=create_info_2, Path=path, Format=True)
read_file = ReadFile()
deconstruct_file = DeconstructFile(File=read_file)  # -> SchemaVersion, Info, ElementsGeometry, ElementsData
deconstruct_element = DeconstructElement(Element=deconstruct_file.ElementsData)  # -> Guid, Type, Info
deconstruct_info = DeconstructInfo(Info=deconstruct_file.Info)  # -> Key, Value
deconstruct_info_2 = DeconstructInfo(Info=deconstruct_element.Info)  # -> flatten(Key), flatten(Value)
assert = Assert(TestNames="Test Schema", Expected="1.0.0", Actual=deconstruct_file.SchemaVersion)  # -> Result, FailedInfo
demesh = DeconstructMesh(Mesh=deconstruct_file.ElementsGeometry)  # -> flatten(Vertices), Faces, Colours, Normals
sort_pt = SortPoints(Points=demesh.Vertices)  # -> Points, Indices
pt = Point([Point(10.46570365, 2.851703449, 1.180921122), Point(10.02291683, 3.306821955, -2.768358177), Point(11.8992046, 4.246362915, 1.180921122), Point(11.45641778, 4.701481421, -2.768358177), Point(10.46570365, 2.851703449, 1.180921122), Point(11.8992046, 4.246362915, 1.180921122)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])
sort_pt_2 = SortPoints(Points=pt)  # -> Points, Indices
txt_2 = Text(["Z Level", "Z Level", "Z Level", "Z Level", "Z Level", "Z Level", "Z Level", "Z Level", "Z Level", "Z Level"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])
txt_3 = Text(["Brick", "Brick", "Brick", "Brick", "Brick", "Brick", "Brick", "Brick", "Brick", "Brick"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])
txt_4 = Text(["0", "1.492557", "2.985112", "4.477668", "5.970223", "7.462779", "8.955334", "10.44789", "11.940445", "13.433001"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])
txt_5 = Text(["91d1ebcf-9daa-4eca-af97-e8ca9e69245f", "08fbe145-ecbd-479f-a178-0750b996f08b", "3cb06912-72da-41a9-931c-3fae9d8e7dc4", "949ea549-c670-4a6c-9b72-467914069d2e", "039068c0-bdca-4a29-bc86-a8861120a288", "53583884-5fcc-4028-87f5-2c53446f3077", "ed9da469-7ec9-4a94-ae57-97d997834a3c", "63e0d631-0753-42ef-9e87-bb7e570e22da", "1e596675-436f-4725-8f3e-4f04c4a3ca73", "03bdd50e-40db-4144-8663-d974e7e0b93a"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])
assert_point_list = AssertPointList(TestName="Test Geometries", ExpectedPointList=sort_pt_2.Points, ActualPointList=sort_pt.Points, Tolerance="0.001")  # -> Result, FailedInfo
assert_list = AssertList(TestName="Test Values", ExpectedList="John Doe", ActualList=deconstruct_info.Value)  # -> Result, FailedInfo
assert_list_2 = AssertList(TestName="Test Keys", ExpectedList="Author", ActualList=deconstruct_info.Key)  # -> Result, FailedInfo
assert_list_3 = AssertList(TestName="Test Type", ExpectedList=txt_3, ActualList=deconstruct_element.Type)  # -> Result, FailedInfo
assert_list_4 = AssertList(TestName="Test Guids", ExpectedList=txt_5, ActualList=deconstruct_element.Guid)  # -> Result, FailedInfo
assert_list_5 = AssertList(TestName="Test Element Values", ExpectedList=txt_4, ActualList=deconstruct_info_2.Value)  # -> Result, FailedInfo
assert_list_6 = AssertList(TestName="Test Element Keys", ExpectedList=txt_2, ActualList=deconstruct_info_2.Key)  # -> Result, FailedInfo
total = Total(Results=flatten([assert.Result, assert_list_2.Result, assert_list.Result, assert_list_4.Result, assert_list_3.Result, assert_list_6.Result, assert_list_5.Result, assert_point_list.Result]))  # -> TotalResult, ReportPart
