# Grasshopper definition LogoDotbimAsDotbim.gh (Grasshopper 1.0.7)
# plug-ins: dotbimGH

mesh = Mesh(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)
create_info = CreateInfo()
crv = Curve([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])
divlength = DivideLength(Curve=crv, Length=Slider(1.34, range=0..10))  # -> Points, Tangents, Parameters
hframe = HorizontalFrame(Curve=graft(crv), Parameter=divlength.Parameters)  # -> flatten(Frame)
rgb = ColourRGB(Alpha=255, Red="233", Green="90", Blue="50")
create_simple_elements_set = CreateSimpleElementsSet(Mesh=mesh, InsertPlanes=hframe, Type="Logo Element", Color=rgb, Info=create_info)  # -> ElementsSet, Preview
create_info_2 = CreateInfo(Keys="Author", Values="John Doe")
panel = Panel("C:\Users\pc\RiderProjects\dotbimGH\TestsInsideGH\LogoDotbimAsDotbim.bim")
path = FilePath(panel)
create_file = CreateFile(ElementsSetsOrElements=create_simple_elements_set.ElementsSet, Info=create_info_2, Path=path)
