# Grasshopper definition MultipleMeshes.gh (Grasshopper 1.0.7)
# plug-ins: dotbimGH, Brontosaurus

geo = Geometry(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)
calendar = Calendar()
tri = Triangulate(Mesh=geo)  # -> Mesh, Count
create_info = CreateInfo(Keys="Geometry type", Values="Cuboid")
X = UnitX(Factor=Slider(50, range=0..100))
geo_2 = Geometry(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)
create_info_2 = CreateInfo(Keys="Geometry type", Values="Cone")
dup = DuplicateData(Data="Brick", Number=3, Order=True)
geo_3 = Geometry(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)
dup_2 = DuplicateData(Data=ColourSwatch(SwatchColor=RGB(130, 3, 3)), Number=3, Order=True)
create_info_3 = CreateInfo(Keys="Geometry type", Values="Cylinder")
txt = Text(["d4254842-6869-4fc4-afa6-db9b5bad37a4", "f6d4bc65-db59-4a6f-811c-9b849f76a0f4", "905b6fe5-e53a-41b2-a12d-37437e92d5bc"])
pln = Plane([Plane(origin=(-3.51549957, 55.532803, 0), x=(0.9981054012, -0.0615272955, 0), y=(0.05145203579, 0.8346629639, 0.548352464)), Plane(origin=(-2.924200432, 98.1186475, 0), x=(0.8190057929, 0.5737852483, 0), y=(-0.5508203923, 0.7862263687, -0.2800803322)), Plane(origin=(-4.534546522, 148.6030417, 0), x=(0.883768455, -0.4679244788, 0), y=(0.3593193533, 0.6786460725, 0.6405693644))])
move = Move(Geometry=pln, Motion=X)  # -> Geometry, Transform
X_2 = UnitX(Factor=Slider(50, range=0..100))
dup_3 = DuplicateData(Data=create_info, Number=3, Order=True)
tri_2 = Triangulate(Mesh=geo_2)  # -> Mesh, Count
txt_2 = Text(["a6c478da-8694-4b78-b0fd-72083b3effa6", "e0ca6733-d51b-4191-8ea9-99ec5d0c687a", "55a253d5-6162-4466-9558-5c6b4c5584a1"])
dup_4 = DuplicateData(Data="Concrete element", Number=3, Order=True)
dup_5 = DuplicateData(Data=ColourSwatch(SwatchColor=RGB(46, 46, 46)), Number=3, Order=True)
tri_3 = Triangulate(Mesh=geo_3)  # -> Mesh, Count
dup_6 = DuplicateData(Data="Block", Number=3, Order=True)
dup_7 = DuplicateData(Data=ColourSwatch(SwatchColor=RGB(7, 176, 114)), Number=3, Order=True)
txt_3 = Text(["ceb2091f-66de-47f1-a43a-fa087dc4c322", "8e3f9e63-d471-46ed-9cd3-5d9d394c2d8c", "0f074c3c-eaa5-4adf-b2a7-59d3f85e0d59"])
dup_8 = DuplicateData(Data=create_info_2, Number=3, Order=True)
move_2 = Move(Geometry=move.Geometry, Motion=X_2)  # -> Geometry, Transform
dup_9 = DuplicateData(Data=create_info_3, Number=3, Order=True)
create_elements_set = CreateElementsSet(Mesh=tri.Mesh, InsertPlanes=pln, Guids=txt, Types=dup, Colors=dup_2, Info=dup_3)  # -> ElementsSet, Preview
create_elements_set_2 = CreateElementsSet(Mesh=tri_2.Mesh, InsertPlanes=move.Geometry, Guids=txt_3, Types=dup_4, Colors=dup_5, Info=dup_8)  # -> ElementsSet, Preview
create_elements_set_3 = CreateElementsSet(Mesh=tri_3.Mesh, InsertPlanes=move_2.Geometry, Guids=txt_2, Types=dup_6, Colors=dup_7, Info=dup_9)  # -> ElementsSet, Preview
# File path to change
panel = Panel("Jane Doe")
create_info_4 = CreateInfo(Keys="Author", Values=panel)
# Connect here to read the file
path = FilePath("C:\Users\pc\RiderProjects\dotbimGH\TestsInsideGH\MultipleMeshes.bim")
create_file = CreateFile(
    ElementsSetsOrElements=[create_elements_set.ElementsSet, create_elements_set_2.ElementsSet, create_elements_set_3.ElementsSet],
    Info=create_info_4,
    Path=path,
    Format=True)
read_file = ReadFile()
deconstruct_file = DeconstructFile(File=read_file)  # -> SchemaVersion, Info, ElementsGeometry, ElementsData
deconstruct_element = DeconstructElement(Element=deconstruct_file.ElementsData)  # -> Guid, Type, Info
demesh = DeconstructMesh(Mesh=deconstruct_file.ElementsGeometry)  # -> flatten(Vertices), Faces, Colours, Normals
pt = Point([Point(-16.78932637, 47.05691117, -14.27199476), Point(-17.24217971, 39.71065361, -3.04755475), Point(9.335202215, 45.44648847, -14.27199476), Point(8.88234888, 38.10023091, -3.04755475), Point(-3.727062139, 46.25169982, -14.27199476), Point(-4.179915474, 38.90544227, -3.04755475)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])
deconstruct_info = DeconstructInfo(Info=deconstruct_file.Info)  # -> Key, Value
deconstruct_info_2 = DeconstructInfo(Info=deconstruct_element.Info)  # -> flatten(Key), flatten(Value)
assert = Assert(TestNames="Test Schema", Expected="1.0.0", Actual=deconstruct_file.SchemaVersion)  # -> Result, FailedInfo
assert_point_list = AssertPointList(TestName="Test Geometries", ExpectedPointList=pt, ActualPointList=demesh.Vertices, Tolerance="0.001")  # -> Result, FailedInfo
txt_4 = Text(["Brick", "Brick", "Brick", "Concrete element", "Concrete element", "Concrete element", "Block", "Block", "Block"])
txt_5 = Text(["Cuboid", "Cuboid", "Cuboid", "Cone", "Cone", "Cone", "Cylinder", "Cylinder", "Cylinder"])
txt_6 = Text(["d4254842-6869-4fc4-afa6-db9b5bad37a4", "f6d4bc65-db59-4a6f-811c-9b849f76a0f4", "905b6fe5-e53a-41b2-a12d-37437e92d5bc", "ceb2091f-66de-47f1-a43a-fa087dc4c322", "8e3f9e63-d471-46ed-9cd3-5d9d394c2d8c", "0f074c3c-eaa5-4adf-b2a7-59d3f85e0d59", "a6c478da-8694-4b78-b0fd-72083b3effa6", "e0ca6733-d51b-4191-8ea9-99ec5d0c687a", "55a253d5-6162-4466-9558-5c6b4c5584a1"])
txt_7 = Text(["Geometry type", "Geometry type", "Geometry type", "Geometry type", "Geometry type", "Geometry type", "Geometry type", "Geometry type", "Geometry type"])
assert_list = AssertList(TestName="Test Values", ExpectedList="Jane Doe", ActualList=deconstruct_info.Value)  # -> Result, FailedInfo
assert_list_2 = AssertList(TestName="Test Keys", ExpectedList="Author", ActualList=deconstruct_info.Key)  # -> Result, FailedInfo
assert_list_3 = AssertList(TestName="Test Type", ExpectedList=txt_4, ActualList=deconstruct_element.Type)  # -> Result, FailedInfo
assert_list_4 = AssertList(TestName="Test Guids", ExpectedList=txt_6, ActualList=deconstruct_element.Guid)  # -> Result, FailedInfo
assert_list_5 = AssertList(TestName="Test Element Values", ExpectedList=txt_5, ActualList=deconstruct_info_2.Value)  # -> Result, FailedInfo
assert_list_6 = AssertList(TestName="Test Element Keys", ExpectedList=txt_7, ActualList=deconstruct_info_2.Key)  # -> Result, FailedInfo
total = Total(Results=flatten([assert.Result, assert_list_2.Result, assert_list.Result, assert_list_4.Result, assert_list_3.Result, assert_list_6.Result, assert_list_5.Result, assert_point_list.Result]))  # -> TotalResult, ReportPart
