# Grasshopper definition SimpleElementsSet.gh (Grasshopper 1.0.7)
# plug-ins: dotbimGH

mesh = Mesh(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)  # disabled
panel = Panel("Furnishing Element")  # disabled
panel_2 = Panel("Price")  # disabled
panel_3 = Panel("2.50$")  # disabled
swatch = ColourSwatch(SwatchColor=RGB(102, 102, 102))  # disabled
number_slider = Slider(1000, range=0..100000)  # disabled
pln = Plane([Plane(origin=(43.68261261, 26.41513049, 0), x=(0.2970725018, -0.9548549255, 0), y=(0.4480268814, 0.1393892025, 0.8830869514)), Plane(origin=(-46.48129125, 44.38952619, 0), x=(0.1245699825, -0.9922108241, 0), y=(0.4692209802, 0.05890970734, 0.8811136806)), Plane(origin=(-20.43879727, -30.13161877, 0), x=(0.8533298195, -0.521371479, 0), y=(0.3266529695, 0.5346336167, 0.7794002396))])  # disabled
create_info = CreateInfo(Keys=panel_2, Values=panel_3)  # disabled
pop3d = Populate3D(
    Region={Plane=PlaneXY(-11.88598887, -14.60532599, 0), X=Domain(0, 203.3039019), Y=Domain(0, 220.2849691), Z=Domain(0, 205.594505)},
    Count=number_slider,
    Seed=1)  # disabled
lng = ListLength(List=pop3d)  # disabled
pl = ConstructPlane(Origin=pop3d, XAxis=Vector(1, 0, 0), YAxis=Vector(0, 1, 0))  # disabled
random = Random(Range=Domain(0, 4), Number=lng, Seed=2)  # disabled
prot = RotatePlane(Plane=pl, Angle=random)  # disabled
create_simple_elements_set = CreateSimpleElementsSet(Mesh=mesh, InsertPlanes=prot, Type=panel, Color=swatch, Info=create_info)  # -> ElementsSet, Preview; disabled
panel_4 = Panel("John Doe")  # disabled
panel_5 = Panel("Author")  # disabled
create_info_2 = CreateInfo(Keys=panel_5, Values=panel_4)  # disabled
panel_6 = Panel("C:\Users\pc\RiderProjects\dotbimGH\TestsInsideGH\SimpleElementsSet.bim")  # disabled
path = FilePath(panel_6)  # disabled
create_file = CreateFile(ElementsSetsOrElements=create_simple_elements_set.ElementsSet, Info=create_info_2, Path=path, Format=True)  # disabled
