# Grasshopper definition TeapotWithoutFormat.gh (Grasshopper 1.0.7)
# plug-ins: dotbimGH, Brontosaurus

calendar = Calendar()
mesh = Mesh(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)
medges = MeshEdges(Mesh=mesh)  # -> NakedEdges, InteriorEdges, NonManifoldEdges
# Write
preview = CustomPreview(
    Geometry=[medges.NakedEdges, medges.InteriorEdges, medges.NonManifoldEdges],
    Material=ColourSwatch(SwatchColor=RGB(0, 0, 0)))
create_info = CreateInfo(Keys="Price", Values="2.50$")
xy = XYPlane(Origin=Point(0, 0, 0))
txt = Text("aac566e9-4f4d-4883-8062-5087b90b9ccf")
create_elements_set = CreateElementsSet(
    Mesh=mesh,
    InsertPlanes=xy,
    Guids=txt,
    Types="Furnishing Element",
    Colors=ColourSwatch(SwatchColor=RGB(153, 153, 153)),
    Info=create_info)  # -> ElementsSet, Preview
# Change file path
panel = Panel("John Doe")
create_info_2 = CreateInfo(Keys="Author", Values=panel)
# Connect here to read the file
path = FilePath("C:\Users\pc\RiderProjects\dotbimGH\TestsInsideGH\TeapotWithoutFormat.bim")
create_file = CreateFile(ElementsSetsOrElements=create_elements_set.ElementsSet, Info=create_info_2, Path=path, Format=Toggle(False))
read_file = ReadFile()
deconstruct_file = DeconstructFile(File=read_file)  # -> SchemaVersion, Info, ElementsGeometry, ElementsData
deconstruct_element = DeconstructElement(Element=deconstruct_file.ElementsData)  # -> Guid, Type, Info
demesh = DeconstructMesh(Mesh=deconstruct_file.ElementsGeometry)  # -> flatten(Vertices), Faces, Colours, Normals
pt = Point([Point(-3, 0, 1.799999952), Point(-2.991600037, 0.08100000024, 1.799999952), Point(-2.991600037, -0.08100000024, 1.799999952), Point(-2.989449978, 0, 1.666162014), Point(-2.984999895, 0, 1.921949983), Point(-2.984999895, 0, 1.921949983)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])
deconstruct_info = DeconstructInfo(Info=deconstruct_file.Info)  # -> Key, Value
deconstruct_info_2 = DeconstructInfo(Info=deconstruct_element.Info)  # -> flatten(Key), flatten(Value)
assert = Assert(TestNames="Test Schema", Expected="1.0.0", Actual=deconstruct_file.SchemaVersion)  # -> Result, FailedInfo
assert_point_list = AssertPointList(TestName="Test Geometries", ExpectedPointList=pt, ActualPointList=demesh.Vertices, Tolerance="0.001")  # -> Result, FailedInfo
txt_2 = Text("aac566e9-4f4d-4883-8062-5087b90b9ccf")
assert_list = AssertList(TestName="Test Values", ExpectedList="John Doe", ActualList=deconstruct_info.Value)  # -> Result, FailedInfo
assert_list_2 = AssertList(TestName="Test Keys", ExpectedList="Author", ActualList=deconstruct_info.Key)  # -> Result, FailedInfo
assert_list_3 = AssertList(TestName="Test Type", ExpectedList="Furnishing Element", ActualList=deconstruct_element.Type)  # -> Result, FailedInfo
assert_list_4 = AssertList(TestName="Test Guids", ExpectedList=txt_2, ActualList=deconstruct_element.Guid)  # -> Result, FailedInfo
assert_list_5 = AssertList(TestName="Test Element Values", ExpectedList="2.50$", ActualList=deconstruct_info_2.Value)  # -> Result, FailedInfo
assert_list_6 = AssertList(TestName="Test Element Keys", ExpectedList="Price", ActualList=deconstruct_info_2.Key)  # -> Result, FailedInfo
total = Total(Results=flatten([assert.Result, assert_list_2.Result, assert_list.Result, assert_list_4.Result, assert_list_3.Result, assert_list_6.Result, assert_list_5.Result, assert_point_list.Result]))  # -> TotalResult, ReportPart
